% Simulink data dictionary tmpsim_online.sldd

RefBus = Simulink.Bus()  % Reference path state at the current path index.
  x_ref: double, Unit="m"  % Reference global x position
  y_ref: double, Unit="m"  % Reference global y position
  psi_ref: double, Unit="rad"  % Reference heading
  kappa_ref: double, Unit="1/m"  % Reference curvature
  v_ref_base: double, Unit="m/s"  % Baseline reference speed
  path_idx: uint32  % Current nearest reference-path index
  ref_valid: boolean  % True when the reference path is valid

MeasBus = Simulink.Bus()  % Vehicle measurements normalized to SI units.
  x: double, Unit="m"  % Vehicle global x position
  y: double, Unit="m"  % Vehicle global y position
  yaw: double, Unit="rad"  % Vehicle heading
  vx: double, Unit="m/s"  % Vehicle longitudinal speed
  vy: double, Unit="m/s"  % Vehicle lateral speed
  yaw_rate: double, Unit="rad/s"  % Vehicle yaw rate
  beta: double, Unit="rad"  % Vehicle sideslip angle
  ay: double, Unit="m/s^2"  % Vehicle lateral acceleration
  delta_meas: double, Unit="rad"  % Average measured front road-wheel angle
  ax_meas: double, Unit="m/s^2"  % Vehicle longitudinal acceleration
  delta_rate_meas: double, Unit="rad/s"  % Measured front-wheel angle rate
  meas_valid: boolean  % True when all mapped measurements are finite

ErrBus = Simulink.Bus()  % Vehicle tracking errors in the Frenet reference frame.
  e_y: double, Unit="m"  % Lateral tracking error
  e_psi: double, Unit="rad"  % Heading tracking error
  e_y_rate: double, Unit="m/s"  % Lateral-error rate
  e_psi_rate: double, Unit="rad/s"  % Heading-error rate
  yaw_ref: double, Unit="rad"  % Reference heading retained for logging
  kappa_ref: double, Unit="1/m"  % Reference curvature retained for control
  v_ref_base: double, Unit="m/s"  % Baseline reference speed retained for control
  err_valid: boolean  % True when tracking errors are valid

HistoryBus = Simulink.Bus()  % Fixed-size Transformer feature history.
  window: double[16 14]  % Feature history ordered from oldest to newest
  latest_feature: double[1 14]  % Current raw feature row
  window_ready: boolean  % True when the history window is full
  history_len: uint16  % Number of valid rows in the history window
  sample_time: double, Unit="s"  % History sample period

RiskRawBus = Simulink.Bus()  % Raw Transformer risk inference outputs.
  r_low_raw: double  % Raw aggregate risk
  r_ey_raw: double  % Raw lateral-error risk
  r_stab_raw: double  % Raw stability risk
  k_v_raw: double  % Raw speed scaling factor
  risk_raw_valid: boolean  % True when raw risk output is valid
  risk_source_id: uint8  % 0 for rule fallback and 1 for Transformer
  transformer_status_code: uint8  % Transformer execution status
  transformer_latency_ms: double, Unit="ms"  % Transformer inference latency

RiskBus = Simulink.Bus()  % Bounded and filtered risk outputs.
  r_low: double  % Filtered aggregate risk
  r_ey: double  % Filtered lateral-error risk
  r_stab: double  % Filtered stability risk
  k_v: double  % Filtered speed scaling factor
  risk_valid: boolean  % True when risk output is valid
  degraded_mode: boolean  % True when the supervisor is degraded
  risk_source_id: uint8  % 0 for rule fallback and 1 for Transformer

MPCParamBus = Simulink.Bus()  % Risk-adapted lateral MPC weights and constraints.
  q_y: double  % Lateral-error weight
  q_psi: double  % Heading-error weight
  q_beta: double  % Sideslip-angle weight
  q_r: double  % Yaw-rate weight
  r_delta: double  % Steering-angle penalty
  r_d_delta: double  % Steering-rate penalty
  beta_max: double, Unit="rad"  % Sideslip-angle limit
  yaw_rate_max: double, Unit="rad/s"  % Yaw-rate limit
  ay_max: double, Unit="m/s^2"  % Lateral-acceleration limit
  delta_max: double, Unit="rad"  % Front-wheel angle limit
  delta_rate_max: double, Unit="rad/s"  % Front-wheel angle-rate limit
  v_ref_adapt: double, Unit="m/s"  % Risk-adapted reference speed
  param_valid: boolean  % True when all MPC parameters are valid

CmdBus = Simulink.Bus()  % Validated high-level vehicle control commands.
  delta_cmd: double, Unit="rad"  % Commanded front-wheel angle
  ax_cmd: double, Unit="m/s^2"  % Commanded longitudinal acceleration
  cmd_valid: boolean  % True when the command is valid
  hold_last_cmd: boolean  % True when the adapter must hold the previous command
  control_mode_id: uint8  % 0 PID, 1 Fixed MPC, 2 Rule-risk MPC, 3 Transformer-MPC